# Grasshopper definition 160925_PE_points.gh (Grasshopper 0.9.76)

line_length = Panel("""3.2
5.1
6.3
4.2""")
panel = Panel("""0
1
2
3""")
# Point:indicate a position in space
# Line:length,direction,position
# Point
# two ends of the line
# the intersection of two lines
# the meeting of lines at the corner of a space or volumn
# the center of field
md_slider = MDSlider(
    slider_value=Point(0.5132578379, 0.5396976122, 0.5),
    SliderMode=0,
    x_domain=Domain(-100, 100),
    y_domain=Domain(-100, 100),
    z_domain=Domain(0, 1))
panel_2 = Panel("""1,2
2,1""")
panel_3 = Panel("""2.0,2.0,0.0
-0.5,4.0,0.0""")
line_length_2 = Number(line_length)
int = Integer(panel)
startpoint = Point(md_slider)
item = ListItem(List=["1,0", "0,1", "-1,0", "0,-1"], Index=int, Wrap=True)
startpoint_2 = Point(panel_2)
vec = Vector(panel_3)
item_2 = ListItem(List=line_length_2, Index=0, Wrap=True)
X = UnitX(Factor=1)
basicvector = Vector(item)
addition = Addition(A=startpoint_2, B=vec)
merge = Merge(Data1=Slider(0.52, range=0..100), Data2=Slider(2.4, range=0..100))
merge_2 = Merge(Data1=Slider(7.61, range=0..100), Data2=Slider(6.19, range=0..100))
amp = Amplitude(Vector=X, Amplitude=item_2)
endpoint = Point(addition)
ln = Line(StartPoint=startpoint_2, EndPoint=addition)
line = LineSDL(Start=startpoint, Direction=X, Length=item_2)
complex = ComplexComponents(Complex=startpoint)  # -> Real, Imaginary
pt = PointOriented(BasePlane=startpoint, UComponent=merge, VComponent=merge_2, WComponent=0)
complex_2 = ComplexComponents(Complex=amp)  # -> Real, Imaginary
item_3 = ListItem(List=startpoint_2, Index="0", Wrap=True)  # -> Item, Item1
item_4 = ListItem(List=endpoint, Index="0", Wrap=True)  # -> Item, Item1
complex_3 = CreateComplex(Real=complex.Real, Imaginary=complex.Imaginary)
complex_4 = CreateComplex(Real=complex_2.Real, Imaginary=complex_2.Imaginary)
item_5 = ListItem(List=pt, Index=0, Wrap=True)  # -> Item, Item1
complex_5 = ComplexComponents(Complex=item_3.Item)  # -> Real, Imaginary
complex_6 = ComplexComponents(Complex=item_4.Item)  # -> Real, Imaginary
complex_7 = ComplexComponents(Complex=item_3.Item1)  # -> Real, Imaginary
complex_8 = ComplexComponents(Complex=item_4.Item1)  # -> Real, Imaginary
X_2 = UnitX(Factor=1)
Y = UnitY(Factor=1)
addition_2 = Addition(A=complex_3, B=complex_4)
subtraction = Subtraction(A=complex_5.Real, B=complex_6.Real)
subtraction_2 = Subtraction(A=complex_5.Imaginary, B=complex_6.Imaginary)
subtraction_3 = Subtraction(A=complex_7.Real, B=complex_8.Real)
subtraction_4 = Subtraction(A=complex_7.Imaginary, B=complex_8.Imaginary)
line_2 = LineSDL(Start=item_5.Item1, Direction=Y, Length=item_2)
line_3 = LineSDL(Start=item_5.Item, Direction=X_2, Length=item_2)
division = Division(A=subtraction_2, B=subtraction)
division_2 = Division(A=subtraction_4, B=subtraction_3)
panel_4 = Panel(addition_2)
k1 = Number(division)
k2 = Number(division_2)
multiplication = Multiplication(A=k1, B=complex_6.Real)
multiplication_2 = Multiplication(A=k2, B=complex_8.Real)
subtraction_5 = Subtraction(A=complex_6.Imaginary, B=multiplication)
subtraction_6 = Subtraction(A=complex_8.Imaginary, B=multiplication_2)
panel_5 = Panel(complex_3)
b1 = Number(subtraction_5)
b2 = Number(subtraction_6)
subtraction_7 = Subtraction(A=b2, B=b1)
subtraction_8 = Subtraction(A=k1, B=k2)
division_3 = Division(A=subtraction_7, B=subtraction_8)
multiplication_3 = Multiplication(A=division_3, B=k2)
addition_3 = Addition(A=multiplication_3, B=b2)
intersection_x = Number(division_3)
intersection_y = Number(addition_3)
xy = XYPlane(Origin=Point(0, 0, 0))
pt_2 = PointOriented(BasePlane=xy, UComponent=intersection_x, VComponent=intersection_y, WComponent=0)
pt_3 = PointOriented(BasePlane=PlaneXY(0, 0, 0), UComponent=0, VComponent=0, WComponent=0)
